# Grasshopper definition 01_Krakegg Stage 01- Moulds_Parametric Mould Script.gh (Grasshopper 1.0.7)
# plug-ins: Pufferfish

# KRAKEGG / Stage 01 GITHUB Repository
# KRAKEGG is a project of IaaC, Institute for Advanced Architecture of Catalonia. developed at Master in Robotics and Advanced Construction in 2019-2020 by:
# 
# Students:
# 
# Abdullah Sheikh
# Andreea Bunica
# Anna Batalle Garcia
# Matt Gordon
# 
# Faculty:
# Angel Munoz
panel = Panel("")

# ---- group: SILICONE OUTPUT CONTROLS
# this is in percentages ->
#  -> size in mm per chamber on the right
air_chamber_height = Slider(6, range=5..10)
air_channel_width_mm_x2 = Slider(2, range=1..3)
air_channel_height = Slider(2.5, range=0..4)

# ---- group: SPACER MOULD CONTROLS
# if you want all thicknesses to be equal, just change the percentage to be equal across chambers
spacer_mould_wall_height = Slider(3, range=0..10)
spacer_height = Slider(1.5, range=0..2)

# ---- group: straightens edges
number_slider = Slider(20, range=0..30)

# ----
# CONTROLS
number_slider_2 = Slider(15, range=0..20)
number_slider_3 = Slider(15, range=0..20)

# ---- group: MOULD CONTROLS
mould_base_thickness = Slider(1, range=1..3)
mould_wall_thickness = Slider(1.5, range=0..10)
mould_wall_height = Slider(6, range=0..10)
base_mould_height = Slider(2, range=0..10)

# ---- group: differencial silicone wall thicknesses
panel_2 = Panel("110")
# percentage is calculated off the amount of offset for each chamber (you can trace back the code)
panel_3 = Panel("70")
panel_4 = Panel("80")

# ----
ellipse = Ellipse(Plane=PlaneXY(0, 0, 0), Radius1=number_slider_2, Radius2=number_slider_3)  # -> Ellipse, Focus1, Focus2
addition = Addition(A=mould_wall_height, B=spacer_mould_wall_height)
# This script is parametrically generating moulds for the production of soft robotics fingers, as used in the Krakegg stage 01 prototype.
# 
# Using this script, you will be able to control the parameters of your mould, such as internal wall thickness, top wall thickness, air chamber width & height, air channels etc.
# 
# 
# **the script is responsive, but it is not fully cleaned up- it will generate some errors at points.
eval = EvaluateCurve(Curve=ellipse.Ellipse, Parameter=ellipse.Focus2)  # -> Point, Tangent, Angle
addition_2 = Addition(A=addition, B=base_mould_height)
ln = Line(StartPoint=ellipse.Focus2, EndPoint=eval.Point)
subtraction = Subtraction(A=addition, B=air_chamber_height)
total_mould_height = Panel(addition_2)
subtraction_2 = Subtraction(A=subtraction, B=1)
number_slider_4 = Slider(45, range=0..100)
len = Length(Curve=ln)
panel_5 = Panel(len)
panel_6 = Panel(number_slider_2)
rotate = Rotate(Geometry=ln, Angle=degrees("-90"), Plane=PlaneXY(0, 0, 0))  # -> Geometry, Transform
Y = UnitY(Factor=expr("-x", number_slider_4))
end = EndPoints(Curve=rotate.Geometry)  # -> Start, End
move = Move(Geometry=end.End, Motion=Y)  # -> Geometry, Transform
addition_3 = Addition(A=panel_5, B=number_slider_4, C=panel_6)

# ---- group: total finger length
panel_7 = Panel(addition_3)

# ----
ln_2 = Line(StartPoint=end.End, EndPoint=move.Geometry)
divide = DivideCurve(Curve=ln_2, Count=Slider(3, range=0..10), Kinks=False)  # -> Points, Tangents, Parameters
item = ListItem(List=divide.Points, Index="3", Wrap=True)
item_2 = ListItem(List=divide.Points, Index="1", Wrap=True)

# ---- group: changes air chamber 02 & 03 proportions
height = Slider(80, range=0..100)
width = Slider(65, range=0..100)
width_2 = Slider(75, range=0..100)
height_2 = Slider(90, range=0..100)

# ----
pcent = Percentage(Number=number_slider_3, Percent=height_2)
pcent_2 = Percentage(Number=number_slider_2, Percent=width_2)
pcent_3 = Percentage(Number=number_slider_3, Percent=height)
pcent_4 = Percentage(Number=number_slider_2, Percent=width)
ellipse_2 = Ellipse(Plane=item, Radius1=pcent_4, Radius2=pcent_3)  # -> Ellipse, Focus1, Focus2
ellipse_3 = Ellipse(Plane=item_2, Radius1=pcent_2, Radius2=pcent)  # -> Ellipse, Focus1, Focus2
wall_thickness = Slider(4, range=0..10)

# ---- group: input curves
crv = Curve(ellipse.Ellipse)
crv_2 = Curve(ellipse_2.Ellipse)
crv_3 = Curve(ellipse_3.Ellipse)

# ----
Y_2 = UnitY(Factor=wall_thickness)
pcent_5 = Percentage(Number=Y_2, Percent=panel_4)
pcent_6 = Percentage(Number=Y_2, Percent=panel_3)
pcent_7 = Percentage(Number=Y_2, Percent=panel_2)

panel_8 = Panel(pcent_5)
panel_9 = Panel(pcent_7)
panel_10 = Panel(pcent_6)

offset = OffsetCurve(Curve=crv, Distance=pcent_7, Plane=PlaneXY(0, 0, 0), Corners=1)
offset_2 = OffsetCurve(Curve=crv_3, Distance=pcent_5, Plane=PlaneXY(0, 0, 0), Corners=1)
offset_3 = OffsetCurve(Curve=crv_2, Distance=pcent_6, Plane=PlaneXY(0, 0, 0), Corners=1)
ccx = CurveCurve(CurveA=offset, CurveB=offset_2)  # -> Points, ParamsA, ParamsB
ccx_2 = CurveCurve(CurveA=offset_2, CurveB=offset_3)  # -> Points, ParamsA, ParamsB
ccx_3 = CurveCurve(CurveA=offset_2, CurveB=offset_3)  # -> Points, ParamsA, ParamsB
shatter = Shatter(Curve=offset, Parameters=ccx.ParamsA)
shatter_2 = Shatter(Curve=offset_3, Parameters=ccx_3.ParamsB)
shatter_3 = Shatter(Curve=offset_2, Parameters=ccx_2.ParamsA)
item_3 = ListItem(List=shatter_2, Index="1", Wrap=True)
item_4 = ListItem(List=shatter, Index="1", Wrap=True)
item_5 = ListItem(List=shatter_3, Index="1", Wrap=True)
ccx_4 = CurveCurve(CurveA=item_4, CurveB=item_5)  # -> Points, ParamsA, ParamsB
crv_4 = Curve(item_5)
shatter_4 = Shatter(Curve=crv_4, Parameters=ccx_4.ParamsB)
rotate_2 = Rotate(Geometry=ln, Angle=degrees("90"), Plane=PlaneXY(0, 0, 0))  # -> Geometry, Transform
item_6 = ListItem(List=shatter_4, Index="0", Wrap=True)
item_7 = ListItem(List=shatter_4, Index="2", Wrap=True)
end_2 = EndPoints(Curve=rotate_2.Geometry)  # -> Start, End
crv_5 = Curve(item_7)
crv_6 = Curve(item_3)
crv_7 = Curve(item_4)
crv_8 = Curve(item_6)
item_8 = ListItem(List=end_2.End, Index="1", Wrap=True)
join = JoinCurves(Curves=[crv_7, crv_8, crv_5, crv_6], Preserve=False)
join_2 = JoinCurves(Curves=flatten(join), Preserve=False)  # -> flatten(Curves)
Y_3 = UnitY(Factor=Slider(2, range=0..10))
move_2 = Move(Geometry=item_8, Motion=Y_3)  # -> Geometry, Transform
fillet = Fillet(Curve=join_2, Radius=number_slider)
ln_3 = Line(StartPoint=move_2.Geometry, EndPoint=item)
multiplication = Multiplication(A=air_channel_width_mm_x2, B="-1")
offset_4 = OffsetCurve(Curve=fillet, Distance=mould_wall_thickness, Plane=PlaneXY(0, 0, 0), Corners=1)  # -> flatten(Curve)
multiplication_2 = Multiplication(A=mould_base_thickness, B="-1")
X = UnitX(Factor=air_channel_width_mm_x2)
X_2 = UnitX(Factor=multiplication)
loft = Loft(
    Curves=[fillet, offset_4],
    Options={Adjust=False, Closed=False, LoftEnds=0, LoftSimp=0, LoftType=0, Rebuild=10, Refit=0.01})
move_3 = Move(Geometry=ln_3, Motion=[X_2, X])  # -> Geometry, Transform
Z = UnitZ(Factor=multiplication_2)
multiplication_3 = Multiplication(A=mould_base_thickness, B="-1")
Z_2 = UnitZ(Factor=air_chamber_height)
loft_2 = Loft(Curves=move_3.Geometry, Options={Adjust=False, Closed=False, LoftEnds=0, LoftSimp=0, LoftType=0, Rebuild=10, Refit=0.01})
Z_3 = UnitZ(Factor=air_channel_height)
srf = Surface(fillet)
Z_4 = UnitZ(Factor=multiplication_3)
move_4 = Move(Geometry=loft, Motion=Z)  # -> Geometry, Transform
Z_5 = UnitZ(Factor=base_mould_height)
Z_6 = UnitZ(Factor=mould_wall_height)
extr = Extrude(Base=[crv, crv_3, crv_2], Direction=Z_2)
extr_2 = Extrude(Base=loft_2, Direction=Z_3)
extr_3 = Extrude(Base=move_4.Geometry, Direction=Z_5)

# ---- group: BASE
extr_4 = Extrude(Base=srf, Direction=Z_4)

# ---- group: WALLS
extr_5 = Extrude(Base=move_4.Geometry, Direction=Z_6)

# ---- group: AIR CHAMBERS
cap = CapHoles(Brep=extr)

# ---- group: AIR CHANNEL
brep = Brep(extr_2)

# ----
Z_7 = UnitZ(Factor=spacer_mould_wall_height)
edges = BrepEdges(Brep=cap)  # -> Naked, flatten(Interior), NonManifold
panel_11 = Panel("""5
7
2""")
crv_9 = Curve(edges.Interior)
join_3 = BrepJoin(Breps=[extr_3, extr_4])  # -> Breps, Closed
Z_8 = UnitZ(Factor=mould_wall_height)
item_9 = ListItem(List=crv_9, Index=panel_11, Wrap=True)  # -> flatten(Item)
X_3 = UnitX(Factor=Slider(100, range=0..100))
brep_2 = Brep(join_3.Breps)
extr_6 = Extrude(Base=move_4.Geometry, Direction=Z_7)
pt = Point(Point(0, -72, 0))

# ---- group: spacer mould
move_5 = Move(Geometry=extr_6, Motion=Z_8)  # -> Geometry, Transform

# ----
move_6 = Move(Geometry=brep_2, Motion=X_3)  # -> Geometry, Transform
offset_5 = OffsetCurve(Curve=item_9, Distance="1", Plane=PlaneXY(0, 0, 0), Corners=1)
alicrvseams = AlignCurveSeams(Curves=offset_5, Guide=pt, Snap=False, Iterative=True)  # -> Aligned, Points, R
divide_2 = DivideCurve(Curve=alicrvseams.Aligned, Count=Slider(9, range=0..100), Kinks=False)  # -> Points, Tangents, Parameters
panel_12 = Panel("""3
6
8
1""")
item_10 = ListItem(List=divide_2.Points, Index=panel_12, Wrap=True)
points = PointList(Points=item_10, Size=Slider(5, range=0..10))
panel_13 = Panel("""1
2""")
panel_14 = Panel("""0
3""")
item_11 = ListItem(List=item_10, Index=panel_13, Wrap=True)
item_12 = ListItem(List=item_10, Index=panel_14, Wrap=True)
pt_2 = Point(item_12)
pt_3 = Point(item_11)
number_slider_5 = Slider(0.974, range=0.8..1)
ln_4 = Line(StartPoint=pt_3, EndPoint=pt_2)
multiplication_4 = Multiplication(A=number_slider_5, B="-1")
scale_nu = ScaleNU(Geometry=ln_4, Plane=PlaneXY(0, 0, 0), ScaleX=1, ScaleY=number_slider_5, ScaleZ=1)  # -> Geometry, Transform
item_13 = ListItem(List=scale_nu.Geometry, Index=0, Wrap=True)  # -> Item, Item1, Item2
number_slider_6 = Slider(1.7, range=0.2..2)
tweencrv = TweenCurve(CurveA=item_13.Item, CurveB=item_13.Item1, Factor=0.5, BlendType=0)
scale_nu_2 = ScaleNU(Geometry=tweencrv, Plane=PlaneXY(0, 0, 0), ScaleX=number_slider_6, ScaleY=1, ScaleZ=1)  # -> Geometry, Transform
merge = Merge(Data1=scale_nu.Geometry, Data2=scale_nu_2.Geometry)
multiplication_5 = Multiplication(A="0.5", B="-1")
offset_6 = OffsetCurve(Curve=merge, Distance=multiplication_5, Plane=PlaneXY(0, 0, 0), Corners=1)
offset_7 = OffsetCurve(Curve=merge, Distance="0.5", Plane=PlaneXY(0, 0, 0), Corners=1)
multiplication_6 = Multiplication(A=spacer_height, B="-1")
loft_3 = Loft(
    Curves=[offset_7, offset_6],
    Options={Adjust=False, Closed=False, LoftEnds=0, LoftSimp=0, LoftType=0, Rebuild=10, Refit=0.01})
Z_9 = UnitZ(Factor=multiplication_6)
scale_nu_3 = ScaleNU(Geometry=loft_3, Plane=PlaneXY(0, 0, 0), ScaleX=number_slider_6, ScaleY=1, ScaleZ=1)  # -> Geometry, Transform
panel_15 = Panel(subtraction_2)
extr_7 = Extrude(Base=loft_3, Direction=Z_9)
Z_10 = UnitZ(Factor=panel_15)
move_7 = Move(Geometry=scale_nu_3.Geometry, Motion=Z_10)  # -> Geometry, Transform
X_4 = UnitX(Factor=Slider(200, range=0..200))
Z_11 = UnitZ(Factor="2")
extr_8 = Extrude(Base=move_7.Geometry, Direction=Z_11)
move_8 = Move(Geometry=extr_7, Motion=Z_10)  # -> Geometry, Transform
join_4 = BrepJoin(Breps=[extr_8, move_8.Geometry, move_5.Geometry])  # -> Breps, Closed

# ---- group: MOULD
join_5 = BrepJoin(Breps=[cap, extr_5, extr_4, brep])  # -> Breps, Closed

# ---- group: SPACER MOULD
move_9 = Move(Geometry=join_4.Breps, Motion=X_4)  # -> Geometry, Transform

# ---- group: BASE MOULD
# BAKE ME!
brep_3 = Brep(move_6.Geometry)
